# Dynamo graph Dynamo file Integration of parameters into BIM.dyn "Integration of parameters into BIM" (Dynamo 2.18.1.5096)
# packages: Civil3DToolkit 1.1.32

current = Autodesk.AutoCAD.DynamoNodes.Document.Current()
cogoPointGroups = CogoPointGroups(document=current)
cogoPoints = Autodesk.Civil.DynamoNodes.CogoPointGroup.CogoPoints(cogoPointGroup=cogoPointGroups)
indexOfPointGroup = IntegerSlider(0, range=0..647 step 1)
selectedPointGroup = List.GetItemAtIndex(list=cogoPoints, index=indexOfPointGroup)
pointNumber = IntegerSlider(422, range=0..647 step 1)
selectedPoint = List.GetItemAtIndex(list=selectedPointGroup, index=pointNumber)
parameterGroup = StringInput("MeasuredValues")
parameterName = StringInput("Gauge")
file_path = Filename("D:\Book1.csv")
file_from_path = FileObject(path=file_path)
sheetName = StringInput("Book1")
extractedParameters = Data.ImportExcel(file=file_from_path, sheetName=sheetName)
parameterValue = List.GetItemAtIndex(list=extractedParameters, index=pointNumber)
indexOfParamter = IntegerSlider(0, range=0..804 step 1)
parametersColumn = List.GetItemAtIndex(list=parameterValue, index=indexOfParamter)
string_from_object = FromObject(object=parametersColumn)
updateProperty = Autodesk.AutoCAD.DynamoNodes.Object.UpdateProperty(object=selectedPoint, propertySetName=parameterGroup, propertyName=parameterName, propertyValue=string_from_object)
defination_of_parameter = StringInput("Gauge")
description_of_defined_parameter = StringInput("MeasuredValues")
parameter_application = StringInput("Cogo Point")
applies_to_all_cogo_points = BoolSelector(true)
definition_of_a_new_user_defined = Autodesk.AutoCAD.DynamoNodes.PropertySetsExtensions.PropertySetDefinitionByParameters(name=defination_of_parameter, description=description_of_defined_parameter, applyTo=parameter_application, appliesToAll=applies_to_all_cogo_points)  # "Definition of a new User-defined property set"
